# Grasshopper definition GCodeGenerator.ghx (Grasshopper 0.9.76)
# plug-ins: Silkworm
# GCode Generator for MSandPrinter

# ---- group: Saving
path = Panel("C:\Users\Maajor\Desktop\")
filename = Panel("test0220.gcode")
save = BooleanToggle(False)

# ----
shell_thickness = Slider(2, range=0..10)
infill_density = Slider(0.3, range=0..1)
layer_height = Slider(2, range=0..10)
binder_speed = Slider(0.1, range=0..0.1)
flip_contour = BooleanToggle(False)
brep = Brep(<brep referenced from the Rhino model>)
unit_z = UnitZ(Factor=1)
contour = Contour(Shape=brep, Point=Point(0, 0, 0), Direction=unit_z, Distance=layer_height)
cluster = Cluster(curve=contour, flip=flip_contour, number=shell_thickness)
shift_paths = ShiftPaths(Data=cluster, Offset=-1)
boundary_surfaces = BoundarySurfaces(Edges=shift_paths)
loadsettings = LoadSettings(String=["absolute_extrudersteps = 1", "acceleration = 0", "bed_size = 200,200", "bed_temperature = 60", "bridge_fan_speed = 100", "bridge_flow_ratio = 1", "bridge_speed = 20", "brim_width = 3", "complete_objects = 0", "cooling = 0"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])
division = Division(A=shell_thickness, B="2")
silkworm_filler = SilkwormFiller(SettingsDictionary=loadsettings, PlanarBreps=boundary_surfaces, InfillType=1, InfillDensity=infill_density)
cluster_2 = Cluster(curve=contour, flip=flip_contour, number=division)
end_points = EndPoints(Curve=silkworm_filler)  # -> Start, End
shift_paths_2 = ShiftPaths(Data=cluster_2, Offset=-1)  # -> simplify(Data)
deconstruct = Deconstruct(Point=end_points.Start)  # -> XComponent, YComponent, ZComponent
delete_consecutive = DeleteConsecutive(Set=deconstruct.ZComponent, Wrap=False)  # -> Set, Count
series = Series(Start=0, Step=1, Count=delete_consecutive.Count)
key_value_search = KeyValueSearch(Keys=delete_consecutive.Set, Values=series, Search=deconstruct.ZComponent)
c_script = CSharpScript(crvs=silkworm_filler, path=key_value_search)  # -> out, A; inputs crvs: list of Curve, path: list of Int32
# ---------- c_script: C# ----------
    DataTree<Curve> result = new DataTree<Curve> ();
    int count = crvs.Count();
    if( count != path.Count()){
      throw new Exception("path not match");
    }
    for(int i = 0; i < count; i++){
      result.Add(crvs[i], new GH_Path(path[i]));
    }
    A = result;
# ---------- end c_script ----------
merge = Merge(Data1=shift_paths_2, Data2=c_script.A)
segmenter = Segmenter(
    Curve=merge,
    MainSegmentCount=0,
    SubSegmentCount=0,
    MaxAngleRadians=0.6,
    MaxChordLengthRatio=0.1,
    MaxAspectRatio=0,
    Tolerance=0,
    MinEdgeLength=0.1,
    MaxEdgeLength=0,
    KeepStartPoint=True)
c_script_2 = CSharpScript(layerHeight=layer_height)  # -> out, LevelGCode; inputs layerHeight: Double
# ---------- c_script_2: C# ----------
    string result = "";
    result += "G0 X250 ;Not Sure Position\n";
    result += string.Format("G91 Z{0:0.00} W{0:0.00} ;Object and Feed Platform\n", layerHeight);
    result += "G0 S-6 ;Sweeper Down\n" +
              "G28 X ;X to Home\n" +
              "G0 S6;Sweeper Up\n" + 
              "G0 X48 ;X to Zero\n" +
              "G92 X;Set X Zero\n";
    LevelGCode = result;
# ---------- end c_script_2 ----------
control_polygon = ControlPolygon(Curve=segmenter)  # -> Polygon, Points
panel = Panel("""G0 X250.00 Y0.00 Z140.00 ;XYZ to End
;the End Of File""")
panel_2 = Panel(c_script_2.LevelGCode)
panel_3 = Panel("""G28 X Y Z ;Set Home
G0 X48.00 ;X to Zero
G92 X ;Set X Zero
G0 Z0.00 ;Z to Zero""")
c_script_3 = CSharpScript()  # -> out, Header
# ---------- c_script_3: C# ----------
    String result = "";
    result += ";GCode For MSandPrinter\n";
    result += ";by Yidong Ma, Tsinghua University\n";
    result += ";at ";
    result += DateTime.Now.ToString();
    result += "\n";
    Header = result;
# ---------- end c_script_3 ----------
simplify_tree = SimplifyTree(Tree=control_polygon.Points, Front=False)
concatenate = Concatenate(FragmentA=c_script_3.Header, FragmentB=panel_3)
c_script_4 = CSharpScript(
    StartGCode=concatenate,
    EndGCode=panel,
    LevelGCode=panel_2,
    pointTree=simplify_tree,
    binderSpeed=binder_speed,
    path=path,
    filename=filename,
    save=save)  # -> out, File; inputs StartGCode: String, EndGCode: String, LevelGCode: String, pointTree: tree of Point3d, binderSpeed: Double, path: String, filename: String, save: Boolean
# ---------- c_script_4: C# ----------
    String resultGcode = "";
    resultGcode += StartGCode;
    int ptTreeCount = pointTree.BranchCount;
    int currentLayerCount = 0;

    List<int> testarr = new List<int> ();

    for(int i = 0; i < ptTreeCount; i++){
      IList<Point3d> thisBranch = pointTree.Branch(i);
      GH_Path thisPath = pointTree.Path(i);
      int thisLayerCount = thisPath.Indices[0];

      //sweep a new layer
      if( thisLayerCount != currentLayerCount){
        currentLayerCount = thisLayerCount;
        resultGcode += LevelGCode;
      }

      Point3d pointStart = thisBranch[0];
      Point3d pointEnd = thisBranch[thisBranch.Count - 1];
      Point3d lastPoint = pointStart;

      resultGcode += string.Format("G0 X{0:0.00} Y{1:0.00}\n", pointStart.X, pointStart.Y);

      for(int j = 1; j < thisBranch.Count - 1; j++){
        Point3d thisPoint = thisBranch[j];
        double distanceToHere = thisPoint.DistanceTo(lastPoint);
        double binderFeed = distanceToHere * binderSpeed;
        resultGcode += string.Format("G0 X{0:0.00} Y{1:0.00} E{2:0.00}\n", thisPoint.X, thisPoint.Y, binderFeed);

        lastPoint = thisPoint;
      }

      resultGcode += string.Format("G0 X{0:0.00} Y{1:0.00}\n", pointEnd.X, pointEnd.Y);

    }
    resultGcode += EndGCode;

    if(save){
      System.IO.File.WriteAllText(path + filename, resultGcode);
    }

    File = resultGcode;
# ---------- end c_script_4 ----------
panel_4 = Panel(c_script_4.out)

# ==== cluster Cluster
curve = ClusterInput()
number = ClusterInput()
curve_2 = Curve(curve)
number_2 = Number(number)
boundary_surfaces = BoundarySurfaces(Edges=curve_2)
offset = Offset(Curve=curve_2, Distance=number_2, Plane=PlaneXY(0, 0, 0), Corners=1)
shift_paths = ShiftPaths(Data=offset, Offset=-1)
end_points = EndPoints(Curve=shift_paths)  # -> Start, End
surface_closest_point = SurfaceClosestPoint(Point=end_points.Start, Surface=boundary_surfaces)  # -> Point, UVPoint, Distance
larger_than = LargerThan(FirstNumber=surface_closest_point.Distance, SecondNumber=expr("x / 2", number_2))  # -> LargerThan, OrEqualTo
flip = ClusterInput()
c_script = CSharpScript(x=larger_than.LargerThan, y=number_2, flip=flip)  # -> out, A; inputs x: Boolean, y: Double, flip: Boolean
# ---------- c_script: C# ----------
    A = (x == flip ? 1 : 0 * 2 - 1) * y;
# ---------- end c_script ----------
offset_2 = Offset(Curve=curve_2, Distance=c_script.A, Plane=PlaneXY(0, 0, 0), Corners=1)
curve_3 = ClusterOutput(offset_2)
